# Grasshopper definition geo.ghx (Grasshopper 1.0.8)
# plug-ins: RhinoCodePluginGH

curve = Curve([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])
point = Point([Point(-0.8391112276, 6.453867549, 0), Point(-13.90110394, 4.895028912, 0), Point(-7.343231058, 1.078561904, 0), Point(6.256292223, 5.325053364, 0), Point(1.095998804, 3.766214727, 0), Point(5.127478038, 1.078561904, 0), Point(9.911500062, 2.95991888, 0), Point(-7.242696716, 5.46049494, 0)])
line = Line(curve)

# ---- group: CSV export
python_3_script = Python3Script(points=point, lines=line)  # -> out, a; inputs points: list, lines: list
# ---------- python_3_script: Python ----------
import Rhino.Geometry as rg
import Grasshopper
import os
import sys

HERE = ghenv.Component.OnPingDocument().FilePath


CSV = os.path.abspath(os.path.join(HERE, '..', '..', 'CSV'))

print(CSV)

# file_path = TXT + "/"+ file_name + ".txt"

# with open(file_path, 'r') as file:
#     txt_lines = file.readlines()
# ---------- end python_3_script ----------

# ----
ghpython_script = GhPythonScript(file_name="state_C", width=Slider(0.08, range=0..0.1))  # -> out, boxes, lines
# ---------- ghpython_script: Python ----------
import Rhino.Geometry as rg
import os
import sys

HERE = HERE = ghenv.LocalScope.ghdoc.Path
print HERE

TXT = os.path.abspath(os.path.join(HERE, '..', '..', 'txt'))

file_path = TXT + "/"+ file_name + ".txt"

with open(file_path, 'r') as file:
    txt_lines = file.readlines()

boxes = []
origin = []
x_axis = []
y_axis = []
length = []
lines = []

#for line in txt_lines:
#    if line.strip() and not line.startswith('----------'):
#        parts = list(map(float, line.split()))
#        if len(parts) == 6:
#            p1 = rg.Point3d(*parts[:3])
#            p2 = rg.Point3d(*parts[3:6])
#            lines.append(rg.Line(p1,p2))
#            length.append(p1.DistanceTo(p2))
#            origin.append( 0.5 * (p1 + p2) )
#            xaxis = p2 - p1
#            x_axis.append(xaxis)
#        elif len(parts) == 3:
#            yaxis = rg.Vector3d(*parts[:])
#            y_axis.append( yaxis )
#            
#for o,x,y,l in zip(origin,x_axis,y_axis,length):
#    
#    pl = rg.Plane(o, x, y)
#    box = rg.Box(pl, 
#        rg.Interval(-0.5*l,0.5*l),
#        rg.Interval(-0.5*width,0.5*width), 
#        rg.Interval(-0.5*width,0.5*width))
#    boxes.append(box)
# ---------- end ghpython_script ----------
